# Grasshopper definition TreeGen(Pine).gh (Grasshopper 1.0.7)
# plug-ins: Human

number_slider = Slider(3, range=0..10)
vertical_branch_count = Slider(10, range=0..10)
squiggle_count = Slider(7, range=0..10)
base_radious = Slider(0.8, range=0..10)
squigglyness = Slider(0.82, range=0..10)
height = Slider(33, range=0..100)
root = Point(Point(-16.67733367, 31.97345181, 0))
range = Range(Domain=Domain(0, 1), Steps=vertical_branch_count)
graph_mapper = GraphMapper(
    range,
    x0=0,
    x1=1,
    y0=0,
    y1=1,
    container_name="Bezier",
    cpx=[0, 0.3846621215, 0.6413043737, 1],
    cpy=[0.3620773554, 0.216304183, 0.3727049828, 0])
generate_trunk = GenerateTrunk(
    root=root,
    height=height,
    squigle_count=squiggle_count,
    squigleyness=squigglyness,
    seed=number_slider,
    base_radious=base_radious,
    profile_radii=graph_mapper)  # -> wire_2, trunk_2
range_2 = Range(Domain=Domain(0, 1), Steps=Slider(15, range=0..20))
rotational_randomness_deg = Slider(100, range=0..100)
length_randomness_0_1 = Slider(0.26, range=0..1)
vertical_randomness_0_1 = Slider(1, range=0..1)
base_branch_height_0_1 = Slider(0.19, range=0..1)
angle_rads = Slider(0.12, range=0..1)
radial_branch_count = Slider(3, range=0..10)
width = Slider(20, range=0..20)
graph_mapper_2 = GraphMapper(
    range_2,
    x0=0,
    x1=1,
    y0=0,
    y1=1,
    container_name="Bezier",
    cpx=[0, 0.2201396525, 0.5968610048, 1],
    cpy=[0.5917871594, 0.3309697509, 0.5961339474, 0])
primary_branches = PrimaryBranches(
    trunk_wire=generate_trunk.wire_2,
    radial_branch_count=radial_branch_count,
    width=width,
    base_branch_height_0_1=base_branch_height_0_1,
    angle=angle_rads,
    rotational_randomness=rotational_randomness_deg,
    vertical_randomness_0_1=vertical_randomness_0_1,
    length_randomness_0_1=length_randomness_0_1,
    seed=number_slider,
    profile_radii=graph_mapper_2)
squigglyness_2 = Slider(0.39, range=0..1)
squiggle_density = Slider(0.957, range=0..10)
add_squiggles = AddSquiggles(wires=primary_branches, branch_squiglyness=squigglyness_2, squigal_density=squiggle_density, seed=number_slider)
density = Slider(0.54, range=0..10)
drupe = Slider(0.11, range=0..1)
branch_rotation = Slider(100, range=0..100)
length = Slider(0.45, range=0..1)
secondary_branches = SecondaryBranches(curves=add_squiggles, density=density, drupe=drupe, rotation=branch_rotation, length=length, seed=number_slider)
squigglyness_3 = Slider(0.06, range=0..1)
squiggle_density_2 = Slider(2, range=0..10)
width_length = Slider(0.01, range=0..0.11)
width_length_2 = Slider(0.01, range=0..0.11)
add_squiggles_2 = AddSquiggles(wires=secondary_branches, branch_squiglyness=squigglyness_3, squigal_density=squiggle_density_2, seed=number_slider)
thicken_branches = ThickenBranches(wires=add_squiggles_2, width_length=width_length_2)
thicken_branches_2 = ThickenBranches(wires=add_squiggles, width_length=width_length)
colour_swatch = ColourSwatch(SwatchColor=RGB(99, 65, 0))
image_resource = ImageResource("C:\Users\15303\Desktop\bark.jpg")  # disabled
curve = Curve(add_squiggles_2)
length_2 = Length(Curve=curve)
custom_preview_materials = CustomPreviewMaterials(
    Geometry=[generate_trunk.trunk_2, thicken_branches_2, thicken_branches],
    DiffuseColor=colour_swatch,
    DiffuseBitmap=image_resource)
custom_preview = CustomPreview(Geometry=[thicken_branches_2, thicken_branches, generate_trunk.trunk_2], Material=colour_swatch)  # disabled
multiplication = Multiplication(A=length_2, B=Slider(0.04, range=0..1))  # -> simplify(Result)
range_3 = Range(Domain=Domain(0, 1), Steps=expr("x+1", multiplication))  # -> simplify(Range)
evaluate_curve = EvaluateCurve(Curve=reparameterize(simplify(graft(curve))), Parameter=range_3)  # -> Point, expr("x*-1", Tangent), Angle
point = Point(Point(1, 20, 0))
point_2 = Point(Point(1, 17, 0))
surface = Surface(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)
vector_2pt = Vector2Pt(PointA=point_2, PointB=point, Unitize=False)  # -> Vector, Length
line_sdl = LineSDL(Start=evaluate_curve.Point, Direction=evaluate_curve.Tangent, Length=1)
image_resource_2 = ImageResource(["C:\Users\15303\Desktop\TexturesCom_Leaves0142_1_masked_S.png", "C:\Users\15303\Desktop\TexturesCom_Leaves0142_1_masked_S.png"])
image_resource_3 = ImageResource("C:\Users\15303\Desktop\try2.png")
orient_direction = OrientDirection(
    Geometry=surface,
    PointA=point_2,
    DirectionA=vector_2pt.Vector,
    PointB=evaluate_curve.Point,
    DirectionB=evaluate_curve.Tangent)  # -> Geometry, Transform
rotate_axis = RotateAxis(Geometry=orient_direction.Geometry, Angle="PI/2", Axis=line_sdl)  # -> Geometry, Transform
custom_preview_materials_2 = CustomPreviewMaterials(
    Geometry=[orient_direction.Geometry, rotate_axis.Geometry],
    DiffuseColor=ColourSwatch(SwatchColor=RGB(79, 130, 34)),
    DiffuseBitmap=image_resource_2,
    TransparencyBitmap=image_resource_3)

# ==== cluster GenerateTrunk
height = ClusterInput()
squigle_count = ClusterInput()
root = ClusterInput()
seed = ClusterInput()
squigleyness = ClusterInput()
base_radious = ClusterInput()
profile_radii = ClusterInput()
height_2 = Number(height)
squigle_count_2 = Number(squigle_count)
root_2 = Point(root)
seed_2 = Number(seed)
squigleyness_2 = Number(squigleyness)
base_radious_2 = Number(base_radious)
profile_radii_2 = Number(profile_radii)
division = Division(A=height_2, B=squigle_count_2)
list_length = ListLength(List=profile_radii_2)
multiplication = Multiplication(A=base_radious_2, B=profile_radii_2)
unit_z = UnitZ(Factor=division)
range = Range(Domain=Domain(0, 1), Steps=expr("x-1", list_length))
linear_array = LinearArray(Geometry=root_2, Direction=unit_z, Count=expr("x + 1", squigle_count_2))  # -> Geometry, Transform
list_length_2 = ListLength(List=linear_array.Geometry)
random = Random(Range=squigleyness_2, Number=list_length_2, Seed=expr("2*x + 1", seed_2))
random_2 = Random(Range=squigleyness_2, Number=list_length_2, Seed=seed_2)
vector_xyz = VectorXYZ(XComponent=random_2, YComponent=random, ZComponent=0)  # -> Vector, Length
move = Move(Geometry=linear_array.Geometry, Motion=vector_xyz.Vector)  # -> Geometry, Transform
interpolate = Interpolate(Vertices=move.Geometry, Degree=3, Periodic=False, KnotStyle=1)  # -> Curve, Length, Domain
pipe_variable = PipeVariable(Curve=reparameterize(interpolate.Curve), Parameters=range, Radii=multiplication, Caps=0)
wire = Curve(interpolate.Curve)
trunk = Brep(pipe_variable)
wire_2 = ClusterOutput(wire)
trunk_2 = ClusterOutput(trunk)

# ==== cluster AddSquiggles
branch_squiglyness = ClusterInput()
squigal_density = ClusterInput()
seed = ClusterInput()
wires = ClusterInput()
branch_squiglyness_2 = Number(branch_squiglyness)
squigal_density_2 = Number(squigal_density)
seed_2 = Seed(seed)
wires_2 = Curve(wires)
length = Length(Curve=wires_2)
multiplication = Multiplication(A=length, B=squigal_density_2)
range = Range(Domain=Domain(0, 1), Steps=multiplication)
evaluate_curve = EvaluateCurve(Curve=reparameterize(graft(wires_2)), Parameter=range)  # -> Point, Tangent, Angle
plane_normal = PlaneNormal(Origin=evaluate_curve.Point, ZAxis=evaluate_curve.Tangent)
list_length = ListLength(List=wires_2)
deconstruct_plane = DeconstructPlane(Plane=plane_normal)  # -> Origin, XAxis, YAxis, simplify(ZAxis)
list_length_2 = ListLength(List=deconstruct_plane.ZAxis)
range_2 = Range(Domain=list_length, Steps=expr("x-1", list_length))
construct_domain = ConstructDomain(DomainStart=expr("-x", branch_squiglyness_2), DomainEnd=branch_squiglyness_2)
multiplication_2 = Multiplication(A=seed_2, B=range_2)
random = Random(Range=graft(construct_domain), Number=list_length_2, Seed=graft(multiplication_2))
random_2 = Random(Range=graft(construct_domain), Number=list_length_2, Seed=graft(multiplication_2))
multiplication_3 = Multiplication(A=deconstruct_plane.YAxis, B=random_2)
multiplication_4 = Multiplication(A=deconstruct_plane.XAxis, B=random)
addition = Addition(A=multiplication_4, B=multiplication_3)
move = Move(Geometry=deconstruct_plane.Origin, Motion=addition)  # -> Geometry, Transform
list_item = ListItem(List=evaluate_curve.Point, Index="-1", Wrap=True)  # -> simplify(Item)
cull_index = CullIndex(List=move.Geometry, Indices=["0", "-1"], Wrap=True)  # -> simplify(List)
list_item_2 = ListItem(List=evaluate_curve.Point, Index="0", Wrap=True)  # -> simplify(Item)
merge = Merge(Data1=list_item, Data2=reverse(cull_index), Data3=list_item_2)
interpolate = Interpolate(Vertices=merge, Degree=3, Periodic=False, KnotStyle=1)  # -> flatten(Curve), Length, Domain
wires_3 = Curve(interpolate.Curve)
wires_4 = ClusterOutput(wires_3)

# ==== cluster PrimaryBranches
vertical_randomness_0_1 = ClusterInput()
rotational_randomness = ClusterInput()
length_randomness_0_1 = ClusterInput()
profile_radii = ClusterInput()
base_branch_height_0_1 = ClusterInput()
seed = ClusterInput()
width = ClusterInput()
trunk_wire = ClusterInput()
radial_branch_count = ClusterInput()
angle = ClusterInput()
rotational_randomness_2 = Number(rotational_randomness)
vertical_randomness_0_1_2 = Number(vertical_randomness_0_1)
length_randomness_0_1_2 = Number(length_randomness_0_1)
profile_radii_2 = Number(profile_radii)
seed_2 = Seed(seed)
width_2 = Number(width)
trunk_wire_2 = Curve(trunk_wire)
angle_2 = ZComponent(angle)
radial_branch_count_2 = Number(radial_branch_count)
base_branch_height_0_1_2 = Number(base_branch_height_0_1)
multiplication = Multiplication(A=width_2, B=profile_radii_2)
list_length = ListLength(List=multiplication)  # -> expr("x-1", Length)
range = Range(Domain=list_length, Steps=radial_branch_count_2)
multiplication_2 = Multiplication(A=range, B=seed_2)
construct_domain = ConstructDomain(DomainStart=base_branch_height_0_1_2, DomainEnd=1)
list_length_2 = ListLength(List=profile_radii_2)  # -> expr("x-1", Length)
subtraction = Subtraction(A="1", B=base_branch_height_0_1_2)
list_length_3 = ListLength(List=profile_radii_2)  # -> expr("x-1", Length)
division = Division(A=subtraction, B=list_length_2)
multiplication_3 = Multiplication(A=division, B=vertical_randomness_0_1_2)
duplicate_data = DuplicateData(Data=flatten(multiplication), Number=flatten(radial_branch_count_2), Order=False)
vector_xyz = VectorXYZ(XComponent="1", YComponent=0, ZComponent=expr("-x", angle_2))  # -> Vector, Length
list_length_4 = ListLength()
construct_domain_2 = ConstructDomain(DomainStart=expr("-x", rotational_randomness_2), DomainEnd=rotational_randomness_2)
range_2 = Range(Domain=list_length_2, Steps=expr("x-1", list_length_2))
multiplication_4 = Multiplication(A=range_2, B=seed_2)
range_3 = Range(Domain=construct_domain, Steps=list_length_2)
random = Random(Range=multiplication_3, Number=radial_branch_count_2, Seed=multiplication_4)
cull_index = CullIndex(List=range_3, Indices="-1", Wrap=True)
subtraction_2 = Subtraction(A=graft(cull_index), B=random)
list_length_5 = ListLength(List=list_length_3)  # -> flatten(Length)
evaluate_curve = EvaluateCurve(Curve=reparameterize(trunk_wire_2), Parameter=subtraction_2)  # -> Point, Tangent, Angle
random_2 = Random(Range=length_randomness_0_1_2, Number=list_length_5, Seed=multiplication_2)  # -> flatten(Random)
multiplication_5 = Multiplication(A=random_2, B="2")
multiplication_6 = Multiplication(A=multiplication_5, B=multiplication)
addition = Addition(A=duplicate_data, B=multiplication_6)
partition_list = PartitionList(List=flatten(addition), Size=flatten(radial_branch_count_2))
line_sdl = LineSDL(Start=simplify(evaluate_curve.Point), Direction=vector_xyz.Vector, Length=simplify(partition_list))
range_4 = Range(Domain="pi * 2", Steps=radial_branch_count_2)
cull_index_2 = CullIndex(List=range_4, Indices="0", Wrap=True)
rotate = Rotate(Geometry=line_sdl, Angle=cull_index_2, Plane=evaluate_curve.Point)  # -> Geometry, Transform
list_length_6 = ListLength(List=rotate.Geometry)  # -> flatten(Length)
random_3 = Random(Range=construct_domain_2, Number=list_length_6, Seed=multiplication_4)
rotate_2 = Rotate(Geometry=rotate.Geometry, Angle=degrees(random_3), Plane=evaluate_curve.Point)  # -> flatten(Geometry), Transform
wires = ClusterOutput(rotate_2.Geometry)

# ==== cluster ThickenBranches
width_length = ClusterInput()
wires = ClusterInput()
wires_2 = Curve(wires)
list_length = ListLength(List=wires_2)
width_length_2 = Number(width_length)
length = Length(Curve=wires_2)
merge = Merge(Data1="0", Data2="1")
duplicate_data = DuplicateData(Data="0", Number=list_length, Order=True)  # -> simplify(flatten(Data))
multiplication = Multiplication(A=length, B=width_length_2)  # -> simplify(flatten(Result))
merge_2 = Merge(Data1=graft(duplicate_data), Data2=graft(multiplication))
pipe_variable = PipeVariable(Curve=reparameterize(graft(wires_2)), Parameters=merge, Radii=merge_2, Caps=0)  # -> flatten(Pipe)
pipe = ClusterOutput(pipe_variable)

# ==== cluster SecondaryBranches
rotation = ClusterInput()
length = ClusterInput()
seed = ClusterInput()
drupe = ClusterInput()
density = ClusterInput()
curves = ClusterInput()
rotation_2 = Number(rotation)
length_2 = Number(length)
seed_2 = Number(seed)
drupe_2 = Number(drupe)
density_2 = Number(density)
curves_2 = Curve(curves)
length_3 = Length(Curve=curves_2)
multiplication = Multiplication(A=length_3, B=density_2)
range = Range(Domain=length_3, Steps=multiplication)
cull_index = CullIndex(List=range, Indices=["0", "-1"], Wrap=True)
list_item = ListItem(List=cull_index, Index=0, Wrap=True)
list_length = ListLength(List=cull_index)
division = Division(A=list_item, B="1.5")
construct_domain = ConstructDomain(DomainStart=division, DomainEnd=expr("-x", division))
flip_matrix = FlipMatrix(Data=construct_domain)
list_length_2 = ListLength(List=flip_matrix)
range_2 = Range(Domain=list_length_2, Steps=list_length_2)
multiplication_2 = Multiplication(A=seed_2, B=range_2)
random = Random(Range=construct_domain, Number=list_length, Seed=graft(multiplication_2))
addition = Addition(A=cull_index, B=random)
evaluate_curve = EvaluateCurve(Curve=graft(curves_2), Parameter=simplify(addition))  # -> simplify(Point), expr("x*-1", simplify(Tangent)), Angle
multiplication_3 = Multiplication(A=addition, B=length_2)
move = Move(Geometry=evaluate_curve.Point, Motion=evaluate_curve.Tangent)  # -> Geometry, Transform
unit_z = UnitZ(Factor=drupe_2)
move_2 = Move(Geometry=move.Geometry, Motion=expr("-x", unit_z))  # -> Geometry, Transform
vector_2pt = Vector2Pt(PointA=evaluate_curve.Point, PointB=move_2.Geometry, Unitize=False)  # -> Vector, Length
construct_domain_2 = ConstructDomain(DomainStart=expr("-x", rotation_2), DomainEnd=rotation_2)
line_sdl = LineSDL(Start=evaluate_curve.Point, Direction=vector_2pt.Vector, Length=multiplication_3)
list_length_3 = ListLength(List=line_sdl)  # -> expr("x-1", Length)
xy_plane = XYPlane(Origin=evaluate_curve.Point)
flip_matrix_2 = FlipMatrix(Data=list_length_3)
list_length_4 = ListLength(List=flip_matrix_2)
range_3 = Range(Domain=list_length_4, Steps=list_length_4)
multiplication_4 = Multiplication(A=seed_2, B=range_3)
random_2 = Random(Range=construct_domain_2, Number=list_length_3, Seed=graft(multiplication_4))
rotate = Rotate(Geometry=line_sdl, Angle=degrees(random_2), Plane=xy_plane)  # -> Geometry, Transform
result = ClusterOutput(rotate.Geometry)
