# Grasshopper definition foliage.gh (Grasshopper 1.0.7)
# plug-ins: Human

deciduous_treegen = DeciduousTreeGen(canopy_breps_1=<geometry referenced from the Rhino model>)  # -> help_2, curves_11, depths_12, tree_13
width = Slider(2.07, range=0..10)
random_rotation = Slider(4.59, range=0..10)
length = Slider(2, range=0..10)
custom_preview = CustomPreview(Geometry=deciduous_treegen.tree_13, Material=ColourSwatch(SwatchColor=RGB(102, 80, 0)))
random_placement = Slider(1, range=0..1)
foliage_type = Slider(4, range=0..10)
panel = Panel(deciduous_treegen.help_2)
foliage_gen = FoliageGen(
    min_depth=Slider(10, range=0..10),
    curves=deciduous_treegen.curves_11,
    depths=deciduous_treegen.depths_12,
    density=Slider(2, range=0..10),
    randomness_of_placement=random_placement,
    length=length,
    width=width,
    random_rotation=random_rotation,
    foliage_type=foliage_type)  # -> geometry, diffuse, transparency
custom_preview_materials = CustomPreviewMaterials(
    Geometry=foliage_gen.geometry,
    DiffuseColor=RGB(255, 255, 255),
    DiffuseBitmap=foliage_gen.diffuse,
    TransparencyBitmap=foliage_gen.transparency)

# ==== cluster DeciduousTreeGen
number_slider = Slider(20, range=0..100)
construct_domain = ConstructDomain(DomainStart=expr("-x", number_slider), DomainEnd=number_slider)
plane_surface = PlaneSurface(Plane=PlaneXY(0, 0, 0), XSize=construct_domain, YSize=construct_domain)
sphere = Sphere(Base=PlaneXY(0, 0, 0), Radius=number_slider)
branch_density_0 = ClusterInput()
canopy_breps_1 = ClusterInput()
split_brep = SplitBrep(Brep=sphere, Cutter=plane_surface)
branch_density_0_2 = Number(branch_density_0)
canopy_breps_1_2 = Brep(canopy_breps_1)
list_item = ListItem(List=split_brep, Index=0, Wrap=True)
ghpython_script = GhPythonScript(y=branch_density_0_2)  # -> a
# ---------- ghpython_script: Python ----------
__author__ = "15303"
__version__ = "2022.03.21"

import rhinoscriptsyntax as rs

if y == None:
    a = 0.05
else:
    a = y
# ---------- end ghpython_script ----------
ghpython_script_2 = GhPythonScript(y=canopy_breps_1_2, x=list_item)  # -> a
# ---------- ghpython_script_2: Python ----------
__author__ = "15303"
__version__ = "2022.03.21"

import rhinoscriptsyntax as rs

if y == None:
    a = x
else:
    a = y
# ---------- end ghpython_script_2 ----------
area = Area(Geometry=ghpython_script_2)  # -> Area, Centroid
multiplication = Multiplication(A=area.Area, Branch_density_0=ghpython_script)
populate_geometry = PopulateGeometry(Geometry=ghpython_script_2, Count=multiplication, Seed=1)  # -> flatten(Population)
base_point_2 = ClusterInput()
min_factor_3 = ClusterInput()
max_factor_4 = ClusterInput()
min_noise_5 = ClusterInput()
max_noise_6 = ClusterInput()
termination_odds_7 = ClusterInput()
termination_depth_8 = ClusterInput()
trunk_width_9 = ClusterInput()
split_randomness_10 = ClusterInput()
help = ClusterInput()
sub_d_tree = GhPythonScript(
    branch_density_0=ghpython_script,
    canopy_brep_1=populate_geometry,
    base_point_2=base_point_2,
    min_factor_3=min_factor_3,
    max_factor_4=max_factor_4,
    min_noise_5=min_noise_5,
    max_noise_6=max_noise_6,
    termination_odds_7=termination_odds_7,
    termination_depth_8=termination_depth_8,
    trunk_width_9=trunk_width_9,
    split_randomness_10=split_randomness_10,
    help=help)  # -> help, curves_11, depths_12, tree_13; inputs canopy_brep_1: list of Point3d, base_point_2: Point3d, help: Int32
# ---------- sub_d_tree: Python ----------
__author__ = "Nick Drian"
__version__ = "Beta"

import rhinoscriptsyntax as rs
import random
import scriptcontext as sc

if base_point_2 == None:
    base_point_2 = [0,0,0]
if len(canopy_brep_1) == 0:
    canopy_brep_1 =\
    [[-30, -30, 20],[-10, -30, 20],[10, -30, 20],[30, -30, 20],\
     [-30, -10, 20],[-10, -10, 20],[10, -10, 20],[30, -10, 20],\
     [-30, 10, 20],[-10, 10, 20],[10, 10, 20],[30, 10, 20],\
     [-30, -30, 20],[-10, 30, 20],[10, 30, 20],[30, 30, 30]]
if min_factor_3 == None:
    min_factor_3 = 0.2
if max_factor_4 == None:
    max_factor_4 = 0.4
if min_noise_5 == None:
    min_noise_5 = -0.1
if max_noise_6 == None:
    max_noise_6 = 0.1
if termination_odds_7 == None:
    termination_odds_7 = 0
if termination_depth_8 == None:
    termination_depth_8 = 4
if trunk_width_9 == None:
    trunk_width_9 = 0.4
if split_randomness_10 == None:
    split_randomness_10 = 0.2

def average(points):
    point = [0,0,0]
    for p in points:
        point = sum(point, p)
    return scale(point, 1 / len(points))

def scale(point, factor):
    return [point[0]*factor, point[1]*factor, point[2]*factor]
    
def sum(a, b):
    return [a[0]+b[0], a[1]+b[1], a[2]+b[2]]

def dif(a, b):
    return sum(a, scale(b, -1))

def dist(a, b):
    return ((a[0]-b[0])**2 + (a[1]-b[1])**2 + (a[2]-b[2])**2)**0.5

def lerp(a, b, w):
    return sum(scale(a, w), scale(b, 1 - w))

def normalize(p):
    return scale(p, 1 / dist(p, [0,0,0]))
    
def in_half(points):
    if len(points) < 4:
        return [points[:1], points[1:]]
    r = random.uniform(0, split_randomness_10)
    c1 = points[0]
    c2 = points[1]
    g1 = points
    g2 = []
    i = 0
    while abs(len(g2)-len(g1)) > 1 and i < 10:
        g1 = []
        g2 = []
        for p in points:
            if dist(p, c1) * (1 + r) < dist(p, c2) * (1 - r):
                g1 += [p]
            else:
                g2 += [p]
        if len(g1) == 0:
            g1 = g2[:1]
            g2 = g2[1:]
        if len(g2) == 0:
            g2 = g1[:1]
            g1 = g1[1:]
        c1 = average(g1)
        c2 = average(g2)
        i += 1
    return [g1, g2]

def process_tree(tree):
    if len(tree[1]) == 1:
        return tree
    center = average(tree[1])
    f = random.uniform(min_factor_3, max_factor_4)
    next = lerp(tree[0], center, 1 - f)
    tree[1] = add_rand(tree[1], dif(center, tree[0]))
    split = in_half(tree[1])
    left = process_tree([next, split[0]])
    right = process_tree([next, split[1]])
    tree[1] = [left, right]
    return tree


def add_rand(leaves, dir):
    noise = random.uniform(min_noise_5, max_noise_6)
    dir = scale(dir, noise)
    result = []
    for leaf in leaves:
        result += [sum(leaf, dir)]
    return result

def add_depth(tree, d = 0):
    if len(tree[1]) == 1:
        tree += [0]
        return 0
    if d >= termination_depth_8 and random.uniform(0,1) < termination_odds_7:
        tree[1] = [tree[1][0][0]]########################
        tree += [0]
        return 0
    depth = max(add_depth(tree[1][0], d + 1), add_depth(tree[1][1], d + 1))
    tree += [depth]
    return depth + 1

def to_pipe(curve, depth):
    rad1 = trunk_width_9 / max_depth * (depth + 1)
    rad2 = trunk_width_9 / max_depth * depth
    return rs.AddPipe(curve,(0.0,1.0),(rad1,rad2))
    

def to_curves(prev, tree, curves, depths):
    depths += [tree[-1]]
    if len(tree[1]) == 1:
        curve = rs.AddLine(tree[0], tree[1][0])
        length1 = rs.CurveLength(prev)
        length2 = rs.CurveLength(curve)
        result = rs.AddBlendCurve([prev, curve], [length1, length2], [False, True], [1,1])
        curves += [result]
        pipe = to_pipe(result, tree[-1])
        return pipe
    if tree[-1] == 0:
        curve = rs.AddLine(tree[0], tree[1][0][0])
        length1 = rs.CurveLength(prev)
        length2 = rs.CurveLength(curve)
        result = rs.AddBlendCurve([prev, curve], [length1, length2], [False, True], [1,1])
        curves += [result]
        pipe = to_pipe(result, tree[-1])
        return pipe
    curve = rs.AddLine(tree[0], tree[1][0][0])
    length1 = rs.CurveLength(prev)
    length2 = rs.CurveLength(curve)
    result = rs.AddBlendCurve([prev, curve], [length1, length2], [False, True], [1,1])
    curves += [result]
    pipe = to_pipe(result, tree[-1])
    left = to_curves(curve, tree[1][0], curves, depths)
    right = to_curves(curve, tree[1][1], curves, depths)
    return pipe + left + right
    
def help_me():
    if help == 0:
        print("The input branch density determines the number of branches per unit of surface area of the canopy.")
    elif help == 1:
        print("The input canopy_brep should contain 1 or more surface or polysurface. These surfaces will determine where branches terminate.")
    elif help == 2:
        print("The input base_point should contain 1 point representing the base of the tree.")
    elif help == 3 or help == 4:
        print("The factor is a number between 0 and 1 and it represents how long each branch is. if the factor is 0.5, each branch will go half way to its canopy. if the factor is 1, each branch will go all the way to the center of its canopy. The factor is a random nuber between min_factor and max_factor.")
    elif help == 5 or help == 6:
        print("The input noise adds randomness to the tree. if the noise is 0, each branch terminates exactly where the canopy is. If the Noise is 1, The canopy is randomly moved a lot. the noise is a random value between min_noise and max_noise.")
    elif help == 7:
        print("Termination is when a branch dosn't make it to the canopy. The odds of each branch terminating are determined by termination_odds. If termination odds are 0, all branches make it to the canopy. If termination odds are 1, all branches terminate early.")
    elif help == 8:
        print("Termination is when a branch dosn't make it to the camopy. Termination depth is how soon branches will begin to terminate. Depth 0 refers to the trunk, Depth 1 refers to branches connected to the trunk, and so on.")
    elif help == 9:
        print("The input trunk width is the radious of the trunk.")
    elif help == 10:
        print("The input split_randomness determines how evenly each fork splits the canopy. If it is 0, each fork will eavenly devide the canopy. If it is 0.5, each fork will split the canopy completely randomly.")
    elif help == 11:
        print("The curves output containts the trees skeliton")
    elif help == 12:
        print("The depths output containts the depth corresponding with each branch. The depth of a branch is the number of forks between the branch and its canopy.")
    elif help == 13:
        print("The tree output contains the surfaces of the tree.")

help_me()
tree = [base_point_2, canopy_brep_1]
process_tree(tree)
add_depth(tree)
max_depth = tree[-1]
start = rs.AddLine(tree[0], tree[1][0][0])
breps = to_pipe(start, tree[-1])
curves_11 = [start]
depths_12 = [tree[-1]]
breps += to_curves(start, tree[1][0], curves_11, depths_12)
breps += to_curves(start, tree[1][1], curves_11, depths_12)
tree_13 = breps
# ---------- end sub_d_tree ----------
help_2 = ClusterOutput(sub_d_tree.help)
curves_11 = ClusterOutput(sub_d_tree.curves_11)
depths_12 = ClusterOutput(sub_d_tree.depths_12)
tree_13 = ClusterOutput(sub_d_tree.tree_13)

# ==== cluster FoliageGen
randomness_of_placement = ClusterInput()
min_depth = ClusterInput()
depths = ClusterInput()
curves = ClusterInput()
density = ClusterInput()
random_rotation = ClusterInput()
foliage_type = ClusterInput()
length = ClusterInput()
randomness_of_placement_2 = Number(randomness_of_placement)
width = ClusterInput()
min_depth_2 = Number(min_depth)
depths_2 = Number(depths)
curves_2 = Curve(curves)
density_2 = Number(density)
random_rotation_2 = Number(random_rotation)
foliage = GhPythonScript(curves=curves_2, depths=depths_2, min_depth=min_depth_2, density=density_2, randomness=randomness_of_placement_2)  # -> points, tangents; inputs curves: list, depths: list
# ---------- foliage: Python ----------
__author__ = "nick drian"
__version__ = "beta"

import rhinoscriptsyntax as rs
import random

def sub(a, b):
    return (a[0] - b[0], a[1] - b[1], a[2] - b[2])
    
def dist(a, b):
    dx = a[0] - b[0]
    dy = a[1] - b[1]
    dz = a[2] - b[2]
    (dx*dx + dy * dy + dz * dz)**0.5

def norm(v):
    size = (v[0]*v[0] + v[1]*v[1] + v[2]*v[2])**0.5
    res = (v[0] / size, v[1] / size, v[2] / size)
    return res

def get_tan(curve, param):
    a = rs.EvaluateCurve(curve, param + 0.001)
    b = rs.EvaluateCurve(curve, param)
    tan = norm(sub(a, b))
    return tan

def main(points, tangents):
    for i in range(len(curves)):
        if int(depths[i]) <= int(min_depth):
            curve = curves[i]
            d = rs.CurveDomain(curve)
            iter = rs.CurveLength(curve) * density
            for i in range(int(iter)):
                param = (i + random.uniform(0, randomness)) / iter * d[1]
                point = rs.EvaluateCurve(curve, param)
                points += [point]
                tan = get_tan(curve, param)
                tangents += [rs.AddPoint(tan)]

tangents = []
points = []
main(points, tangents)
# ---------- end foliage ----------
foliage_type_2 = Integer(foliage_type)
length_2 = Number(length)
width_2 = Number(width)
vector = Vector(foliage.tangents)
point = Point(foliage.points)
panel = Panel(foliage.tangents)
vector_display = VectorDisplay(Anchor=point, Vector=vector)
unit_z = UnitZ(Factor=1)
line_sdl = LineSDL(Start=point, Direction=vector, Length=length_2)
rotate = Rotate(Vector=vector, Axis=unit_z, Angle="pi/2")
multiplication = Multiplication(A=rotate, B=width_2)
extrude = Extrude(Base=line_sdl, Direction=multiplication)
division = Division(A=multiplication, B="2")
construct_domain = ConstructDomain(DomainStart=expr("-x", random_rotation_2), DomainEnd=random_rotation_2)
move = Move(Geometry=extrude, Motion=expr("-x", division))  # -> Geometry, Transform
xy_plane = XYPlane(Origin=point)
list_length = ListLength(List=move.Geometry)
random = Random(Range=construct_domain, Number=list_length, Seed=2)
image_resource = ImageResource("C:\Users\15303\Desktop\TreeGen\Leaves\Acer_rubrum.jpg")
image_resource_2 = ImageResource("C:\Users\15303\Desktop\TreeGen\Leaves\individual-single-autumn-fall-leaf-against-white-background-graphic-AMNXKH.jpg")
image_resource_3 = ImageResource("C:\Users\15303\Desktop\TreeGen\Leaves\8-89211_keramat-accessories-uv-textures-tree-leaf-texture-png.png")
image_resource_4 = ImageResource("C:\Users\15303\Desktop\TreeGen\Leaves\8-89742_tree-leaf-texture-png-transparent-png.png")
image_resource_5 = ImageResource("C:\Users\15303\Desktop\TreeGen\Leaves\Fall-Leaves.jpg")
image_resource_6 = ImageResource("C:\Users\15303\Desktop\TreeGen\Leaves\robinia_pseudo_acacia_leaf-1488EE5068563C7EA6E.jpg")
image_resource_7 = ImageResource("C:\Users\15303\Desktop\TreeGen\Leaves\Leaves0142_1_600.jpg")
image_resource_8 = ImageResource("C:\Users\15303\Desktop\TreeGen\Leaves\Acer_rubrum.png")
image_resource_9 = ImageResource("C:\Users\15303\Desktop\TreeGen\Leaves\MapleTrans.png")
image_resource_10 = ImageResource("C:\Users\15303\Desktop\TreeGen\Leaves\leaves-t.png")
image_resource_11 = ImageResource("C:\Users\15303\Desktop\TreeGen\Leaves\Fall-Leaves-t.png")
image_resource_12 = ImageResource("C:\Users\15303\Desktop\TreeGen\Leaves\transparency.png")
image_resource_13 = ImageResource("C:\Users\15303\Desktop\TreeGen\Leaves\Studio_Project-modified.jpeg")
image_resource_14 = ImageResource("C:\Users\15303\Desktop\TreeGen\Leaves\transp.png")
rotate_2 = Rotate(Geometry=move.Geometry, Angle=random, Plane=xy_plane)  # -> Geometry, Transform
geometry = ClusterOutput(rotate_2.Geometry)
ghpython_script = GhPythonScript(
    selection=foliage_type_2,
    p1=image_resource_4,
    t1=image_resource_14,
    p2=image_resource_6,
    t2=image_resource_12,
    p3=image_resource,
    t3=image_resource_8,
    p4=image_resource_2,
    t4=image_resource_9,
    p5=image_resource_7,
    t5=image_resource_13,
    p6=image_resource_3,
    t6=image_resource_10,
    p7=image_resource_5,
    t7=image_resource_11)  # -> out, diffuse, transparency
# ---------- ghpython_script: Python ----------
__author__ = "15303"
__version__ = "2022.04.13"

import rhinoscriptsyntax as rs

if selection == 1:
    diffuse = p1
    transparency = t1
elif selection == 2:
    diffuse = p2
    transparency = t2
elif selection == 3:
    diffuse = p3
    transparency = t3
elif selection == 4:
    print("here")
    diffuse = p4
    transparency = t4
elif selection == 5:
    diffuse = p5
    transparency = t5
elif selection == 6:
    diffuse = p6
    transparency = t6
elif selection == 7:
    diffuse = p7
    transparency = t7
# ---------- end ghpython_script ----------
diffuse = ClusterOutput(ghpython_script.diffuse)
transparency = ClusterOutput(ghpython_script.transparency)
